# Grasshopper definition hops_plot_example.gh (Grasshopper 1.0.7)
# plug-ins: Hops

# MORE INFO AT: https://www.antoinemaes.com/plot-it
# &
# https://github.com/MaesAntoine/Hops_plots
panel = Panel("http://127.0.0.1:5000/")
data = Data(Tree({0;0;0;0}: [1], {0;0;0;1}: [3], {0;0;0;2}: [3], {0;0;0;3}: [3], {0;0;0;4}: [3], {0;0;0;5}: [1]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))
data_2 = Data(Tree({0;0;0;0}: [110], {0;0;0;1}: [89], {0;0;0;2}: [92], {0;0;0;3}: [92], {0;0;0;4}: [104], {0;0;0;5}: [122]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))
data_3 = Data(Tree({0;0;0;0}: [19], {0;0;0;1}: [17], {0;0;0;2}: [14], {0;0;0;3}: [16], {0;0;0;4}: [14], {0;0;0;5}: [19]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))

# ---- group: EXAMPLE_PROJECTS
# Data is organized as follows {A;B;C;D} :
# 
# - A: Which project the window is on
# - B: Which façade the window is on
# - C: Which floor the window is on
# - D: Which position (from left to right)the window is at
data_4 = Data(Tree({0;0;0;0}: [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], {0;0;0;1}: [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], {0;0;0;2}: [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], {0;0;0;3}: [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], {0;0;0;4}: [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], {0;0;1;0}: [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]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))

# ---- group: get currently supported plots and palettes from categories
concat = Concatenate(FragmentA=panel, FragmentB="presets")
hops = Hops(
    _Path=concat,
    PlotTypes="categorical",
    PaletteTypes="diverging",
    CacheResultsInMemory=False,
    CacheSolveResults=False,
    RemoteDefinitionLocation="http://127.0.0.1:5000/presets",
    RemoteSolveVersion=(0, 1, 0),
    ShowInput_Enabled=False,
    ShowInput_Path=True,
    SynchronousSolve=True)  # -> AvailablePlots, AvailablePalettes

# ---- group: build dataframe to plot
datatree_nomenclature = Panel("""Project
Facade
Floor
Window""")
merge = Merge(Data1=data, Data2=data_2, Data3=data_3)
concat_2 = Concatenate(FragmentA=panel, FragmentB="dt_to_df")
data_in_datatree = Panel("""View
Solar
Radiation""")
hops_2 = Hops(
    _Path=concat_2,
    DataAsTree=merge,
    TreeStructureLabels=datatree_nomenclature,
    Datatype=data_in_datatree,
    CacheResultsInMemory=False,
    CacheSolveResults=False,
    RemoteDefinitionLocation="http://127.0.0.1:5000/dt_to_df",
    RemoteSolveVersion=(0, 1, 0),
    ShowInput_Enabled=False,
    ShowInput_Path=True,
    SynchronousSolve=True)

# ---- group: select the plot and the palette within their category
list = ValueList({"0", "1", "2", "3", "4", "5", "6", "7", "8"}, selected="5")
item = ListItem(List=hops.AvailablePlots, Index=list, Wrap=True)
item_2 = ListItem(List=hops.AvailablePalettes, Index=Slider(8, range=0..17), Wrap=True)
concat_3 = Concatenate(FragmentA=panel, FragmentB=item)
panel_2 = Panel(item)

# ---- group: plotting
plot = Button()
# Component can fail either for abnormal inputs for the specified plot, or if the main thread has been caught in outside of the main loop.
# 
# If any of the two happens, you should restart the server.
# 
# No comments from devs for 300 days #hopsisdead
hops_3 = Hops(
    _Path=concat_3,
    Dataframe=hops_2,
    XAxis="Facade",
    YAxis="View",
    Hue="Project",
    Dodge=True,
    KDepth="tukey",
    Palette=item_2,
    Fliers=True,
    Plot=plot,
    CacheResultsInMemory=False,
    CacheSolveResults=False,
    RemoteDefinitionLocation="http://127.0.0.1:5000/boxenplot",
    RemoteSolveVersion=(0, 1, 0),
    ShowInput_Enabled=False,
    ShowInput_Path=True,
    SynchronousSolve=True)
